# Grasshopper definition Physics_001.gh (Grasshopper 1.0.7)
# plug-ins: Hops

# ----
# Data Visualization
# The Addition of Vectors
# from 3 Point3D objects
# s = s1 + s2
# Instructions:
# 1. Drag and drop a hops node on the canvas.
# 2. Set path to:
# http://127.0.0.1:5000/vector_addition_02
# 3. Name and toggle  component name to :
# vector_addition_02
gene_pool = GenePool(Decimals=2, Maximum=100, Minimum=0, Value=[75.23140315, 43.70725916, 56.6764822])
gene_pool_2 = GenePool(Decimals=2, Maximum=100, Minimum=0, Value=[7.91251073, 80.32, 11.54450556])
gene_pool_3 = GenePool(Decimals=2, Maximum=100, Minimum=0, Value=[80.67143354, 15.163077, 0])
construct_point = ConstructPoint(XCoordinate=gene_pool, YCoordinate=gene_pool_3, ZCoordinate=gene_pool_2)
construct_point_2 = ConstructPoint(XCoordinate=0, YCoordinate=0, ZCoordinate=0)
point = Point(construct_point)
point_2 = Point(construct_point_2)
point_3 = Point(Point(34.7423778, 63.55382817, 40.36001909))
vector_addition_02 = Hops(
    PointA=point_2,
    PointB=point_3,
    PointC=point,
    CacheResultsInMemory=True,
    CacheSolveResults=True,
    RemoteDefinitionLocation="http://127.0.0.1:5000/vector_addition_02",
    RemoteSolveVersion=(0, 1, 0),
    ShowInput_Enabled=False,
    ShowInput_Path=False,
    SynchronousSolve=True)  # -> Vector1, Vector2, Vector
vector_display = VectorDisplay(Anchor=point_2, Vector=vector_addition_02.Vector1)
vector_display_2 = VectorDisplay(Anchor=point_3, Vector=vector_addition_02.Vector2)
vector_display_3 = VectorDisplay(Anchor=point_2, Vector=vector_addition_02.Vector)
panel = Panel(vector_addition_02.Vector)

# ----
# The Addition of Vectors
# from 3 Point3D objects
# s = s1 + s2
construct_point_3 = ConstructPoint(XCoordinate=0, YCoordinate=0, ZCoordinate=0)
construct_point_4 = ConstructPoint(XCoordinate=0, YCoordinate=0, ZCoordinate=0)
# instantaneous_velocity
# v(t) = 3*t**2 + 2*t + 1
number_slider = Slider(10, range=0..10)
# average_velocity
# v = (xf - xi)/(tf - ti)
number_slider_2 = Slider(0, range=0..10)

# ----
# 3D Domain for
# Data Visualization
# Physics into Grasshopper
# at www.wickersonstudios.com
panel_2 = Panel("100")
center_box = CenterBox(Base=PlaneXY(0, 0, 0), X=panel_2, Y=panel_2, Z=panel_2)
deconstruct_brep = DeconstructBrep(Brep=center_box)  # -> Faces, Edges, Vertices
construct_point_5 = ConstructPoint(XCoordinate=0, YCoordinate=0, ZCoordinate=0)
curve = Curve(deconstruct_brep.Edges)

# ----
# Speed, Displacement, and Velocity:
# An Introduction to Vectors
# average_speed
number_slider_3 = Slider(6, range=0..10)
# instantaneous_speed
# v(t) = 3*t**2 + 2*t + 1
number_slider_4 = Slider(2.97, range=0..10)
# displacement
# btw 2 point3D objects
# s = xf - xi
number_slider_5 = Slider(2.49, range=0..10)
# displacement
# d = xf - xi
number_slider_6 = Slider(2.49, range=0..10)
point_4 = Point(Point(42.50655165, 36.62572425, 9.652863727))
point_5 = Point(construct_point_3)
point_6 = Point(Point(34.7423778, 23.09480784, 40.36001909))
point_7 = Point(construct_point_4)
point_8 = Point(Point(34.7423778, 23.09480784, 40.36001909))
# Instructions:
# 1. Drag and drop a hops node on the canvas.
# 2. Set path to:
# http://127.0.0.1:5000/vector_addition_02
# 3. Name and toggle  component name to :
# vector_addition_02
vector_addition_02_2 = Hops(
    PointA=point_5,
    PointB=point_6,
    PointC=point_4,
    CacheResultsInMemory=True,
    CacheSolveResults=True,
    RemoteDefinitionLocation="http://127.0.0.1:5000/vector_addition_02",
    RemoteSolveVersion=(0, 1, 0),
    ShowInput_Enabled=False,
    ShowInput_Path=False,
    SynchronousSolve=True)  # -> Vector1, Vector2, Vector
average_velocity = Hops(
    InitialPosition=number_slider_2,
    FinalPosition=Slider(10, range=0..10),
    InitialTime=Slider(0, range=0..10),
    FinalTime=number_slider,
    CacheResultsInMemory=False,
    CacheSolveResults=False,
    RemoteDefinitionLocation="http://127.0.0.1:5000/average_velocity",
    RemoteSolveVersion=(0, 1, 0),
    ShowInput_Enabled=False,
    ShowInput_Path=False,
    SynchronousSolve=True)
# Instructions:
# 1. Drag and drop a hops node on the canvas.
# 2. Set path to:
# http://127.0.0.1:5000/instantaneous_velocity
# 3. Name and toggle  component name to :
# instantaneous_velocity
instantaneous_velocity = Hops(
    Time=Slider(2.49, range=0..10),
    CacheResultsInMemory=True,
    CacheSolveResults=True,
    RemoteDefinitionLocation="http://127.0.0.1:5000/instantaneous_velocity",
    RemoteSolveVersion=(0, 1, 0),
    ShowInput_Enabled=False,
    ShowInput_Path=False,
    SynchronousSolve=True)
# Instructions:
# 1. Drag and drop a hops node on the canvas.
# 2. Set path to:
# http://127.0.0.1:5000/displacement
# 3. Name and toggle  component name to :
# displacement
# Instructions:
# 1. Drag and drop a hops node on the canvas.
# 2. Set path to:
# http://127.0.0.1:5000/displacement
# 3. Name and toggle  component name to :
# displacement
displacement = Hops(
    InitialPosition=Slider(6, range=0..10),
    FinalPosition=number_slider_5,
    CacheResultsInMemory=True,
    CacheSolveResults=True,
    RemoteDefinitionLocation="http://127.0.0.1:5000/displacement",
    RemoteSolveVersion=(0, 1, 0),
    ShowInput_Enabled=False,
    ShowInput_Path=False,
    SynchronousSolve=True)
# Instructions:
# 1. Drag and drop a hops node on the canvas.
# 2. Set path to:
# http://127.0.0.1:5000/average_velocity
# 3. Name and toggle  component name to :
# average_velocity
vector = Hops(
    PointA=point_7,
    PointB=point_8,
    CacheResultsInMemory=True,
    CacheSolveResults=True,
    RemoteDefinitionLocation="http://127.0.0.1:5000/vector",
    RemoteSolveVersion=(0, 1, 0),
    ShowInput_Enabled=False,
    ShowInput_Path=False,
    SynchronousSolve=True)
# Instructions:
# 1. Drag and drop a hops node on the canvas.
# 2. Set path to:
# http://127.0.0.1:5000/average_speed
# 3. Name and toggle  component name to :
# average_speed
average_speed = Hops(
    Distance=number_slider_3,
    Time=number_slider_4,
    CacheResultsInMemory=True,
    CacheSolveResults=True,
    RemoteDefinitionLocation="http://127.0.0.1:5000/average_speed",
    RemoteSolveVersion=(0, 1, 0),
    ShowInput_Enabled=False,
    ShowInput_Path=False,
    SynchronousSolve=True)
# Instructions:
# 1. Drag and drop a hops node on the canvas.
# 2. Set path to:
# http://127.0.0.1:5000/instantaneous_speed
# 3. Name and toggle  component name to :
# instantaneous_speed
instantaneous_speed = Hops(
    Time=number_slider_6,
    CacheResultsInMemory=True,
    CacheSolveResults=True,
    RemoteDefinitionLocation="http://127.0.0.1:5000/instantaneous_speed",
    RemoteSolveVersion=(0, 1, 0),
    ShowInput_Enabled=False,
    ShowInput_Path=False,
    SynchronousSolve=True)
panel_3 = Panel(average_velocity)
panel_4 = Panel(instantaneous_velocity)
panel_5 = Panel(vector)
vector_display_4 = VectorDisplay(Anchor=point_7, Vector=vector)
panel_6 = Panel(displacement)
panel_7 = Panel(average_speed)
panel_8 = Panel(instantaneous_speed)
vector_display_5 = VectorDisplay(Anchor=point_5, Vector=vector_addition_02_2.Vector1)
vector_display_6 = VectorDisplay(Anchor=point_6, Vector=vector_addition_02_2.Vector2)
vector_display_7 = VectorDisplay(Anchor=point_5, Vector=vector_addition_02_2.Vector)
panel_9 = Panel(vector_addition_02_2.Vector)
# tip_to_tail_01
# R = s1 + s2 + s3 = s2 + s1 + s3
construct_point_6 = ConstructPoint(XCoordinate=0, YCoordinate=0, ZCoordinate=0)
# tip_to_tail_02
# R = s1 + s2 + s3 = s2 + s1 + s3
construct_point_7 = ConstructPoint(XCoordinate=0, YCoordinate=0, ZCoordinate=0)
# Parallelogram Method
# parallelogram_01
construct_point_8 = ConstructPoint(XCoordinate=0, YCoordinate=0, ZCoordinate=0)
# Subtraction of Vectors
# vector_subtraction_03
construct_point_9 = ConstructPoint(XCoordinate=0, YCoordinate=0, ZCoordinate=0)
point_9 = Point(Point(42.50655165, 36.62572425, 9.652863727))
point_10 = Point(Point(34.7423778, 23.09480784, 40.36001909))
point_11 = Point(construct_point_6)
point_12 = Point(Point(42.50655165, 36.62572425, 9.652863727))
point_13 = Point(Point(42.50655165, 9.209814789, 9.652863727))
point_14 = Point(Point(34.7423778, 23.09480784, 40.36001909))
point_15 = Point(construct_point_7)
point_16 = Point(construct_point_8)
point_17 = Point(Point(34.7423778, 23.09480784, 50.7232884))
point_18 = Point(Point(42.50655165, 36.62572425, 9.652863727))

trigger = Trigger(Interval=100, TimerInterval=100, Target=data_recorder)  # disabled
data_recorder = DataRecorder("1", DataLimit=-10, RecordData=False)
list_length = ListLength(List=data_recorder)
division = Division(A=list_length, B=Slider(79, range=0..1000))
cosine = Cosine(Value=division)
sine = Sine(Value=division)
panel_10 = Panel(cosine)
panel_11 = Panel(sine)

point_19 = Point(construct_point_9)
point_20 = Point(Point(34.7423778, 23.09480784, 50.7232884))
point_21 = Point(Point(47.53506754, 26.73469343, 21.07325545))
# Instructions:
# 1. Drag and drop a hops node on the canvas.
# 2. Set path to:
# http://127.0.0.1:5000/tip_to_tail_02
# 3. Name and toggle  component name to :
# tip_to_tail_02
tip_to_tail_02 = Hops(
    PointA=point_15,
    PointB=point_14,
    PointC=point_12,
    PointD=point_13,
    CacheResultsInMemory=True,
    CacheSolveResults=True,
    RemoteDefinitionLocation="http://127.0.0.1:5000/tip_to_tail_02",
    RemoteSolveVersion=(0, 1, 0),
    ShowInput_Enabled=False,
    ShowInput_Path=False,
    SynchronousSolve=True)  # -> Vector1, Vector2, Vector3, ResultantVector
# Instructions:
# 1. Drag and drop a hops node on the canvas.
# 2. Set path to:
# http://127.0.0.1:5000/tip_to_tail_01
# 3. Name and toggle  component name to :
# tip_to_tail_01
tip_to_tail_01 = Hops(
    PointA=point_11,
    PointB=point_10,
    PointC=point_9,
    CacheResultsInMemory=True,
    CacheSolveResults=True,
    RemoteDefinitionLocation="http://127.0.0.1:5000/tip_to_tail_01",
    RemoteSolveVersion=(0, 1, 0),
    ShowInput_Enabled=False,
    ShowInput_Path=False,
    SynchronousSolve=True)  # -> Vector1, Vector2, ResultantVector
# Instructions:
# 1. Drag and drop a hops node on the canvas.
# 2. Set path to:
# http://127.0.0.1:5000/parallelogram_01
# 3. Name and toggle  component name to :
# parallelogram_01
parallelogram_01 = Hops(
    PointA=point_16,
    PointB=point_17,
    PointC=point_18,
    CacheResultsInMemory=True,
    CacheSolveResults=True,
    RemoteDefinitionLocation="http://127.0.0.1:5000/parallelogram_01",
    RemoteSolveVersion=(0, 1, 0),
    ShowInput_Enabled=False,
    ShowInput_Path=False,
    SynchronousSolve=True)  # -> Vector1, Vector2, ResultantVector
# Instructions:
# 1. Drag and drop a hops node on the canvas.
# 2. Set path to:
# http://127.0.0.1:5000/vector_subtraction_03
# 3. Name and toggle  component name to :
# vector_subtraction_03
vector_subtraction_03 = Hops(
    PointA=point_19,
    PointB=point_20,
    PointC=point_21,
    CacheResultsInMemory=True,
    CacheSolveResults=True,
    RemoteDefinitionLocation="http://127.0.0.1:5000/vector_subtraction_03",
    RemoteSolveVersion=(0, 1, 0),
    ShowInput_Enabled=False,
    ShowInput_Path=False,
    SynchronousSolve=True)  # -> Vector1, Vector2, ResultantVector
vector_display_8 = VectorDisplay(Anchor=point_11, Vector=tip_to_tail_01.Vector1)
vector_display_9 = VectorDisplay(Anchor=point_10, Vector=tip_to_tail_01.Vector2)
vector_display_10 = VectorDisplay(Anchor=point_11, Vector=tip_to_tail_01.ResultantVector)
panel_12 = Panel(tip_to_tail_01.ResultantVector)
panel_13 = Panel(point_13)
vector_display_11 = VectorDisplay(Anchor=point_15, Vector=tip_to_tail_02.Vector1)
vector_display_12 = VectorDisplay(Anchor=point_14, Vector=tip_to_tail_02.Vector2)
vector_display_13 = VectorDisplay(Anchor=point_12, Vector=tip_to_tail_02.Vector3)
vector_display_14 = VectorDisplay(Anchor=point_15, Vector=tip_to_tail_02.ResultantVector)
panel_14 = Panel(parallelogram_01.ResultantVector)
vector_display_15 = VectorDisplay(Anchor=point_16, Vector=parallelogram_01.ResultantVector)
vector_display_16 = VectorDisplay(Anchor=point_16, Vector=parallelogram_01.Vector1)
vector_display_17 = VectorDisplay(Anchor=point_16, Vector=parallelogram_01.Vector2)
vector_display_18 = VectorDisplay(Anchor=point_19, Vector=vector_subtraction_03.Vector1)
vector_display_19 = VectorDisplay(Anchor=point_20, Vector=vector_subtraction_03.Vector2)
vector_display_20 = VectorDisplay(Anchor=point_19, Vector=vector_subtraction_03.ResultantVector)
number_slider_7 = Slider(100, range=0..100)
number_slider_8 = Slider(100, range=0..100)

# ----
# 3D Domain for
# Data Visualization
xz_plane = XZPlane(Origin=Point(0, 0, 0))
number_slider_9 = Slider(0.1, range=0..1)
number_slider_10 = Slider(0.84, range=0..1)
negative = Negative(Value="100")
construct_point_10 = ConstructPoint(XCoordinate=panel_10, YCoordinate=panel_11, ZCoordinate=0)
sphere = Sphere(Base=PlaneXY(0, 0, 0), Radius="100")
construct_domain = ConstructDomain(DomainStart=negative, DomainEnd="100")
evaluate_surface = EvaluateSurface(Surface=reparameterize(sphere), Point=construct_point_10)  # -> Point, Normal, UDirection, VDirection, Frame
deconstruct_brep_2 = DeconstructBrep(Brep=sphere)  # -> Faces, Edges, Vertices
plane_surface = PlaneSurface(Plane=PlaneXY(0, 0, 0), XSize=construct_domain, YSize=construct_domain)
surface_closest_point = SurfaceClosestPoint(Point=evaluate_surface.Point, Surface=plane_surface)  # -> Point, UVPoint, Distance
construct_point_11 = ConstructPoint(XCoordinate=0, YCoordinate=0, ZCoordinate=0)
point_22 = Point(surface_closest_point.Point)
sphere_2 = Sphere(Base=evaluate_surface.Point, Radius=Slider(4, range=0..100))
vector_2pt = Vector2Pt(PointA=point_22, PointB=evaluate_surface.Point, Unitize=False)  # -> Vector, Length
vector_2pt_2 = Vector2Pt(PointA=construct_point_11, PointB=point_22, Unitize=False)  # -> Vector, Length
vector_2pt_3 = Vector2Pt(PointA=construct_point_11, PointB=evaluate_surface.Point, Unitize=False)  # -> Vector, Length
vector_display_21 = VectorDisplay(Anchor=construct_point_11, Vector=vector_2pt_3.Vector)
vector_display_22 = VectorDisplay(Anchor=construct_point_11, Vector=vector_2pt_2.Vector)
vector_display_23 = VectorDisplay(Anchor=point_22, Vector=vector_2pt.Vector)
angle = Angle(VectorA=vector_2pt_2.Vector, VectorB=vector_2pt_3.Vector)  # -> Angle, Reflex
degrees = Degrees(Radians=angle.Angle)
degrees_2 = Panel(degrees)
# Problem Solving Guide
colour_swatch = ColourSwatch(SwatchColor=RGB(0, 0, 0))
text_tag_3d = TextTag3D(Location=xz_plane, Text=degrees_2, Size=Slider(10, range=0..10), Colour=colour_swatch, Justification=7)

construct_point_12 = ConstructPoint(XCoordinate=number_slider_7, YCoordinate=0, ZCoordinate=0)
# Component Method
# for Adding Vectors
construct_point_13 = ConstructPoint(XCoordinate=0, YCoordinate=number_slider_8, ZCoordinate=0)
# Component Method
# for Adding Vectors
# R = math.sqrt(Rx**2 + Ry**2 + Rz**2)
# Unit Vectors
number_slider_11 = Slider(100, range=0..100)
# Trigonometric
# Functions
number = Number(vector_2pt_2.Length)
# A Component
# of a Vector
number_2 = Number(vector_2pt_3.Length)
number_3 = Number(vector_2pt.Length)
# Instructions:
# 1. Drag and drop a hops node on the canvas.
# 2. Set path to:
# http://127.0.0.1:5000/vector_components_03
# 3. Name and toggle  component name to :
# vector_components_03
construct_point_14 = ConstructPoint(XCoordinate=0, YCoordinate=0, ZCoordinate=0)
# mathematical_operations_with_units
number_slider_12 = Slider(0.25, range=0..1)
vector_xyz = VectorXYZ(XComponent=number_slider_7, YComponent=number_slider_8, ZComponent=0)  # -> Vector, Length
vector_2pt_4 = Vector2Pt(PointA=construct_point_14, PointB=construct_point_12, Unitize=False)  # -> Vector, Length
vector_2pt_5 = Vector2Pt(PointA=construct_point_14, PointB=construct_point_13, Unitize=False)  # -> Vector, Length
# Instructions:
# 1. Drag and drop a hops node on the canvas.
# 2. Set path to:
# http://127.0.0.1:5000/trigonometric_functions_04
# 3. Name and toggle  component name to :
# trigonometric_functions_04
trigonometric_functions_04 = Hops(
    Adjacent=number,
    Opposite=number_3,
    Hypotenuse=number_2,
    CacheResultsInMemory=False,
    CacheSolveResults=False,
    RemoteDefinitionLocation="http://127.0.0.1:5000/trigonometric_functions_04",
    RemoteSolveVersion=(0, 1, 0),
    ShowInput_Enabled=False,
    ShowInput_Path=False,
    SynchronousSolve=True)  # -> Sine, Cosine, Tangent
construct_point_15 = ConstructPoint(XCoordinate=0, YCoordinate=0, ZCoordinate=0)
construct_point_16 = ConstructPoint(XCoordinate=Slider(100, range=0..100), YCoordinate=0, ZCoordinate=0)
construct_point_17 = ConstructPoint(XCoordinate=0, YCoordinate=Slider(100, range=0..100), ZCoordinate=0)
# Instructions:
# 1. Drag and drop a hops node on the canvas.
# 2. Set path to:
# http://127.0.0.1:5000/component_method_09
# 3. Name and toggle  component name to :
# component_method_09
construct_point_18 = ConstructPoint(XCoordinate=0, YCoordinate=0, ZCoordinate=number_slider_11)
sin_cos_tan = Panel([trigonometric_functions_04.Sine, trigonometric_functions_04.Cosine, trigonometric_functions_04.Tangent])
degrees_3 = Panel(degrees_2)
angle_2 = Angle(VectorA=vector_xyz.Vector, VectorB=vector_2pt_4.Vector)  # -> Angle, Reflex
# Instructions:
# 1. Drag and drop a hops node on the canvas.
# 2. Set path to:
# http://127.0.0.1:5000/unit_vectors
# 3. Name and toggle  component name to :
# unit_vectors
# Instructions:
# 1. Drag and drop a hops node on the canvas.
# 2. Set path to:
# http://127.0.0.1:5000/mathematical_operations_with_units
# 3. Name and toggle  component name to :
# mathematical_operations_with_units
mathematical_operations_with_units = Hops(
    Length=number_slider_12,
    Time=Slider(2, range=0..10),
    CacheResultsInMemory=True,
    CacheSolveResults=True,
    RemoteDefinitionLocation="http://127.0.0.1:5000/mathematical_operations_with_units",
    RemoteSolveVersion=(0, 1, 0),
    ShowInput_Enabled=False,
    ShowInput_Path=False,
    SynchronousSolve=True)
vector_display_24 = VectorDisplay(Anchor=construct_point_14, Vector=vector_xyz.Vector)
vector_display_25 = VectorDisplay(Anchor=construct_point_14, Vector=vector_2pt_4.Vector)
vector_display_26 = VectorDisplay(Anchor=construct_point_14, Vector=vector_2pt_5.Vector)
panel_15 = Panel(mathematical_operations_with_units)
vector_2pt_6 = Vector2Pt(PointA=construct_point_15, PointB=construct_point_16, Unitize=False)  # -> Vector, Length
vector_2pt_7 = Vector2Pt(PointA=construct_point_15, PointB=construct_point_17, Unitize=False)  # -> Vector, Length
vector_2pt_8 = Vector2Pt(PointA=construct_point_15, PointB=construct_point_18, Unitize=False)  # -> Vector, Length
vector_components_03 = Hops(
    Vector=vector_xyz.Vector,
    Length=vector_xyz.Length,
    Angle=angle_2.Angle,
    CacheResultsInMemory=False,
    CacheSolveResults=False,
    RemoteDefinitionLocation="http://127.0.0.1:5000/vector_components_03",
    RemoteSolveVersion=(0, 1, 0),
    ShowInput_Enabled=False,
    ShowInput_Path=False,
    SynchronousSolve=True)  # -> XComponent, YComponent
sin_cos_tan_2 = Panel(vector_components_03.YComponent)
degrees_4 = Panel(vector_components_03.XComponent)
construct_point_19 = ConstructPoint(XCoordinate=0, YCoordinate=vector_components_03.YComponent, ZCoordinate=0)
construct_point_20 = ConstructPoint(XCoordinate=vector_components_03.XComponent, YCoordinate=0, ZCoordinate=0)
construct_point_21 = ConstructPoint(XCoordinate=0, YCoordinate=0, ZCoordinate=0)
# Instructions:
# 1. Drag and drop a hops node on the canvas.
# 2. Set path to:
# http://127.0.0.1:5000/component_method_08
# 3. Name and toggle  component name to :
# component_method_08
vector_display_27 = VectorDisplay(Anchor=construct_point_15, Vector=vector_2pt_6.Vector)
vector_display_28 = VectorDisplay(Anchor=construct_point_15, Vector=vector_2pt_7.Vector)
vector_display_29 = VectorDisplay(Anchor=construct_point_15, Vector=vector_2pt_8.Vector)
component_method_09 = Hops(
    Vector1=vector_2pt_6.Vector,
    Vector2=vector_2pt_7.Vector,
    Vector3=vector_2pt_8.Vector,
    CacheResultsInMemory=False,
    CacheSolveResults=False,
    RemoteDefinitionLocation="http://127.0.0.1:5000/component_method_09",
    RemoteSolveVersion=(0, 1, 0),
    ShowInput_Enabled=False,
    ShowInput_Path=False,
    SynchronousSolve=True)
unit_vectors = Hops(
    Vector=component_method_09,
    CacheResultsInMemory=True,
    CacheSolveResults=True,
    RemoteDefinitionLocation="http://127.0.0.1:5000/unit_vectors",
    RemoteSolveVersion=(0, 1, 0),
    ShowInput_Enabled=False,
    ShowInput_Path=False,
    SynchronousSolve=True)
component_method_08 = Hops(
    Vector1=vector_2pt_6.Vector,
    Vector2=vector_2pt_7.Vector,
    Vector3=vector_2pt_8.Vector,
    CacheResultsInMemory=True,
    CacheSolveResults=True,
    RemoteDefinitionLocation="http://127.0.0.1:5000/component_method_08",
    RemoteSolveVersion=(0, 1, 0),
    ShowInput_Enabled=False,
    ShowInput_Path=False,
    SynchronousSolve=True)
vector_2pt_9 = Vector2Pt(PointA=construct_point_21, PointB=construct_point_19, Unitize=False)  # -> Vector, Length
vector_2pt_10 = Vector2Pt(PointA=construct_point_21, PointB=construct_point_20, Unitize=False)  # -> Vector, Length
vector_display_30 = VectorDisplay(Anchor=construct_point_15, Vector=component_method_08)
vector_display_31 = VectorDisplay(Anchor=construct_point_15, Vector=unit_vectors)
vector_display_32 = VectorDisplay(Anchor=construct_point_15, Vector=component_method_09)
vector_display_33 = VectorDisplay(Anchor=construct_point_14, Vector=vector_2pt_10.Vector)
vector_display_34 = VectorDisplay(Anchor=construct_point_14, Vector=vector_2pt_9.Vector)
construct_point_22 = ConstructPoint(XCoordinate=0, YCoordinate=0, ZCoordinate=0)
construct_point_23 = ConstructPoint(XCoordinate=0, YCoordinate=0, ZCoordinate=0)

v1_angle = Slider(30, range=0..90)
v1_length = Slider(30, range=0..100)
v2_length = Slider(20, range=0..100)
v2_angle = Slider(140, range=0..180)

v1_angle_2 = Slider(40, range=0..90)
v1_length_2 = Slider(20, range=0..100)
v2_length_2 = Slider(40, range=0..100)
v2_angle_2 = Slider(127, range=0..180)
unit_x = UnitX(Factor=v1_length)
unit_z = UnitZ(Factor=1)
# #A boat can travel at a speed of v1 km/h in still water.
# #In a flowing river, it can move v2 km/h relative to the water.
# #If the river flows at a speed of v3 km/h,
# #how fast can the boat travel upstream?
# #How fast can it travel downstream?
unit_x_2 = UnitX(Factor=v2_length)
unit_x_3 = UnitX(Factor=v1_length_2)
unit_z_2 = UnitZ(Factor=1)
# #Find the x- and y-components of a D meter displacement vector at
# #an angle of A degrees counterclockwise from the +x axis
unit_x_4 = UnitX(Factor=v2_length_2)
speed_relative_to_water = Slider(8, range=0..10)
# #Using the graphical method in Fig. a, b and c.
# #find the resultant of the following pairs of vectors
# #the angles being taken relative to the +x axis, as is customary in physics
# #Give your answer to two significant figures
number_slider_13 = Slider(30, range=0..360)
# #A runner makes one complete lap around a D m track in a time of T s.
# #What were the runner's (a) average speed and (b) average velocity?
number_slider_14 = Slider(6, range=0..10)
# From Fig. 2-1.
change_in_distance = Panel("4.00")
meters_per_second = Slider(4.25, range=0..10)
# #Change the speed S cm/s to units of kilometers per year.
# #Use 365 days in a year.
distance_in_meters = Slider(17, range=0..20)
# #Using the graphical method in Fig. 2-2 and Fig. 2-3,
# #find the resultant of the following pairs of vectors
# #the angles being taken relative to the +x axis, as is customary in physics
# #Give your answer to two significant figures
number_slider_15 = Slider(25, range=0..100)
# #Rolling along across the machine shop at a constant speed of S m/s,
# #a robot covers a distance of D m.
# #How long does it take the robot to travel this distance?
minutes = Slider(30, range=0..100)
# #A kid stands adj meters from the base of a flagpole which is opp meters tall.
# #Determine the magnitude of the displacement of the brass eagle on top of the flagpole
# #with respect to the kids feet
change_in_time = Panel("8.00")
# #A toy train moves along a winding track at an average speed of S m/s.
# #How far will it travel in T minutes?
meters_second = Slider(0.55, range=0..1)
km = Slider(10, range=0..20)
# #A student driving a car travels D km in T minutes.
# #What is the student's average speed in m/s?
minutes_2 = Slider(4, range=0..10)
speed_of_water = Slider(3, range=0..10)
speed_of_boat = Slider(8, range=0..10)
# #A car travels along a road and its odometer readings are plotted
# #against time in a Fig. 2-1. See notes for Fig. 2-1.
# #Find the instantaneous speed of the car at points A and B.
# #What is the car's average speed?
number_slider_16 = Slider(0.2, range=0..1)
radians = Radians(Degrees=v1_angle)
radians_2 = Radians(Degrees=v2_angle)
radians_3 = Radians(Degrees=v1_angle_2)
radians_4 = Radians(Degrees=v2_angle_2)
rotate = Rotate(Vector=unit_x, Axis=unit_z, Angle=radians)
rotate_2 = Rotate(Vector=unit_x_2, Axis=unit_z, Angle=radians_2)
rotate_3 = Rotate(Vector=unit_x_3, Axis=unit_z_2, Angle=radians_3)
rotate_4 = Rotate(Vector=unit_x_4, Axis=unit_z_2, Angle=radians_4)
car_01 = Hops(
    Distance=change_in_distance,
    Time=change_in_time,
    CacheResultsInMemory=True,
    CacheSolveResults=True,
    RemoteDefinitionLocation="http://127.0.0.1:5000/car_01",
    RemoteSolveVersion=(0, 1, 0),
    ShowInput_Enabled=False,
    ShowInput_Path=False,
    SynchronousSolve=True)
radians_5 = Radians(Degrees=number_slider_13)
graphical_method_02 = Hops(
    Length1=v1_length,
    Angle1=radians,
    Length2=v2_length,
    Angle2=radians_2,
    CacheResultsInMemory=False,
    CacheSolveResults=False,
    RemoteDefinitionLocation="http://127.0.0.1:5000/graphical_method_02",
    RemoteSolveVersion=(0, 1, 0),
    ShowInput_Enabled=False,
    ShowInput_Path=False,
    SynchronousSolve=True)  # -> ResultantVector, Magnitude, Angle
move = Move(Geometry=construct_point_22, Motion=rotate)  # -> Geometry, Transform
flagpole_01 = Hops(
    Adjacent=Slider(8, range=0..10),
    Opposite=number_slider_14,
    CacheResultsInMemory=False,
    CacheSolveResults=False,
    RemoteDefinitionLocation="http://127.0.0.1:5000/flagpole_01",
    RemoteSolveVersion=(0, 1, 0),
    ShowInput_Enabled=False,
    ShowInput_Path=False,
    SynchronousSolve=True)
runner_01 = Hops(
    Distance=Slider(200, range=0..1000),
    Time=number_slider_15,
    CacheResultsInMemory=True,
    CacheSolveResults=True,
    RemoteDefinitionLocation="http://127.0.0.1:5000/runner_01",
    RemoteSolveVersion=(0, 1, 0),
    ShowInput_Enabled=False,
    ShowInput_Path=False,
    SynchronousSolve=True)  # -> Speed, Velocity
graphical_method_02_2 = Hops(
    Length1=v1_length_2,
    Angle1=radians_3,
    Length2=v2_length_2,
    Angle2=radians_4,
    CacheResultsInMemory=False,
    CacheSolveResults=False,
    RemoteDefinitionLocation="http://127.0.0.1:5000/graphical_method_02",
    RemoteSolveVersion=(0, 1, 0),
    ShowInput_Enabled=False,
    ShowInput_Path=False,
    SynchronousSolve=True)  # -> ResultantVector, Magnitude, Angle
student_car_01 = Hops(
    Distance=km,
    Time=minutes,
    CacheResultsInMemory=True,
    CacheSolveResults=True,
    RemoteDefinitionLocation="http://127.0.0.1:5000/student_car_01",
    RemoteSolveVersion=(0, 1, 0),
    ShowInput_Enabled=False,
    ShowInput_Path=False,
    SynchronousSolve=True)
toy_train_01 = Hops(
    Speed=meters_second,
    Time=minutes_2,
    CacheResultsInMemory=False,
    CacheSolveResults=False,
    RemoteDefinitionLocation="http://127.0.0.1:5000/toy_train_01",
    RemoteSolveVersion=(0, 1, 0),
    ShowInput_Enabled=False,
    ShowInput_Path=False,
    SynchronousSolve=True)
robot_01 = Hops(
    Speed=meters_per_second,
    Distance=distance_in_meters,
    CacheResultsInMemory=True,
    CacheSolveResults=True,
    RemoteDefinitionLocation="http://127.0.0.1:5000/robot_01",
    RemoteSolveVersion=(0, 1, 0),
    ShowInput_Enabled=False,
    ShowInput_Path=False,
    SynchronousSolve=True)
boat_01 = Hops(
    Speed1=speed_of_boat,
    Speed2=speed_relative_to_water,
    Speed3=speed_of_water,
    CacheResultsInMemory=True,
    CacheSolveResults=True,
    RemoteDefinitionLocation="http://127.0.0.1:5000/boat_01",
    RemoteSolveVersion=(0, 1, 0),
    ShowInput_Enabled=False,
    ShowInput_Path=False,
    SynchronousSolve=True)  # -> SpeedUpstream, SpeedDownstream
move_2 = Move(Geometry=construct_point_23, Motion=rotate_3)  # -> Geometry, Transform
speed_04 = Hops(
    Speed=number_slider_16,
    CacheResultsInMemory=True,
    CacheSolveResults=True,
    RemoteDefinitionLocation="http://127.0.0.1:5000/speed_04",
    RemoteSolveVersion=(0, 1, 0),
    ShowInput_Enabled=False,
    ShowInput_Path=False,
    SynchronousSolve=True)
average_velocity_2 = Panel(car_01)
degrees_5 = Degrees(Radians=graphical_method_02.Angle)
average_velocity_3 = Panel(flagpole_01)
average_velocity_4 = Panel([runner_01.Speed, runner_01.Velocity])
degrees_6 = Degrees(Radians=graphical_method_02_2.Angle)
vector_display_35 = VectorDisplay(Anchor=construct_point_23, Vector=rotate_3)
vector_display_36 = VectorDisplay(Anchor=move_2.Geometry, Vector=rotate_4)
seconds = Panel(robot_01)
meters_per_second_2 = Panel(student_car_01)
meters = Panel(toy_train_01)
panel_16 = Panel([boat_01.SpeedUpstream, boat_01.SpeedDownstream])
displacement_01 = Hops(
    Length=Slider(25, range=0..100),
    Angle=radians_5,
    CacheResultsInMemory=True,
    CacheSolveResults=True,
    RemoteDefinitionLocation="http://127.0.0.1:5000/displacement_01",
    RemoteSolveVersion=(0, 1, 0),
    ShowInput_Enabled=False,
    ShowInput_Path=False,
    SynchronousSolve=True)  # -> XComponent, YComponent
panel_17 = Panel(speed_04)

vector_display_37 = VectorDisplay(Anchor=move.Geometry, Vector=rotate_2)
vector_display_38 = VectorDisplay(Anchor=construct_point_22, Vector=rotate)

addition = Addition(A="180", B=degrees_5)
panel_18 = Panel([displacement_01.XComponent, displacement_01.YComponent])
addition_2 = Addition(A="180", B=degrees_6)

# ----
# #find the resultant
#  of the vectors
vector_display_39 = VectorDisplay(Anchor=construct_point_22, Vector=graphical_method_02.ResultantVector)
resultant_magnitude_angle = Panel([graphical_method_02.Magnitude, degrees_5])

# ----
# #find the resultant
#  of the vectors
vector_display_40 = VectorDisplay(Anchor=construct_point_23, Vector=graphical_method_02_2.ResultantVector)
resultant_magnitude_angle_2 = Panel([graphical_method_02_2.Magnitude, addition_2])
